# Grasshopper definition Rail2.gh (Grasshopper 1.0.7)

number_slider = Slider(2.743, range=0.5..5)
number_slider_2 = Slider(2.038, range=1..3)
panel = Panel("""69.35
66.45
63.25
59.75
56
51.7
46
6.6
8.25
9.85
12
14.4
17.35
21.55
69.6
66.7
63.6
60.25
56.65
52.5
47.45
40.4
0.7
3
5.1
7.5
10
13
17.3
23.4""")
number_slider_3 = Slider(1.079, range=0.5..3)
number_slider_4 = Slider(1.144, range=0.5..5)
panel_2 = Panel("""100
112.5
125
137.5
150
162.5
175
100
112.5
125
137.5
150
162.5
175
100
112.5
125
137.5
150
162.5
175
187.5
100
112.5
125
137.5
150
162.5
175
187.5""")
panel_3 = Panel("""-1
-1
-1
-1
-1
-1
-1
-1
-1
-1
-1
-1
-1
-1
-11
-11
-11
-11
-11
-11
-11
-11
-11
-11
-11
-11
-11
-11
-11
-11""")
c_script = CSharpScript(x=panel_2, y=panel_3, Angle=panel, T1=number_slider_4, T2=number_slider, T3=number_slider_2, T4=number_slider_3)  # -> out, A, B, C, D, E; inputs x: list of Double, y: list of Double, Angle: list of Double, T1: Double, T2: Double, T3: Double, T4: Double
# ---------- c_script: C# ----------
    if(distPts.Count == 0 || angles.Count == 0 || distPts.Count != angles.Count){
      distPts.Clear();angles.Clear();
      for(int i = 0;i < x.Count;i++){
        distPts.Add(new Point3d(x[i], y[i], 0));
        angles.Add(Angle[i]);
      }
    }
    grids = Grid();
    t1 = T1;
    t2 = T2;
    t3 = T3; t4 = T4;
    dispc.Clear();
    dispc2.Clear();
    dispc3.Clear();
    dispc4.Clear();
    /////////////////////////////////////////////////////////
    double maxout = 0;
    for(int i = 0;i < x.Count;i++){
      Curve c = Rail1(angles[i]);
      Point3d pt = distPts[i];
      double t0;
      c.ClosestPoint(pt, out t0);
      Point3d pt2 = c.PointAt(t0);

      maxout += pt.DistanceTo(pt2);
      if(i < 13) {dispc.Add(c);}
      else{
        break;
        // dispc2.Add(c);
      }
    }

    /////////////////////////////////////////////////////////
    A = distPts;
    E = maxout;
# ---------- c_script: C# additional code ----------
  List<Point3d> distPts = new List<Point3d>();
  List<double> angles = new List<double>();
  public double dt = 1.0 / 60.0;
  double t1 = 1;
  double t2 = 1;
  double t3 = 1;
  double t4 = 1;
  List<Curve> dispc = new List<Curve>();
  List<Curve> dispc2 = new List<Curve>();
  List<Curve> dispc3 = new List<Curve>();
  List<Curve> dispc4 = new List<Curve>();
  List<Line> grids = new List<Line>();

  public Curve Rail1(double x, double time){
    double mass = 1;
    double volume = mass / (30.0*t4);
    List<Point3d> ps = new List<Point3d>();
    double vx = 80 / mass;
    if(vx > 60.8)vx = 60.8;
    Vector3d v0 = new Vector3d(vx, 0, 0);
    v0.Rotate(x * Math.PI / 180, Vector3d.ZAxis);
    Point3d p0 = new Point3d(0, 0, 0);
    ps.Add(p0);
    for(double i = 0;i <= time;i += dt){
      double speed = v0.Length;
      double drag = speed * speed * volume * 10.0 * 0.1 * t2;
      Vector3d v1 = new Vector3d(v0); v1.Unitize(); v1 *= -drag * 0.1;
      Vector3d v2 = new Vector3d(0, -9.82 * (mass - volume * 10.0 * 1 * t3) * t1, 0);
      p0 = p0 + v0 * dt + (v1 + v2) / mass * dt * dt / 2.0;
      v0 = v0 + (v1 + v2) / mass * dt;
      ps.Add(p0);
      //Print(v1.ToString());
    }
    return Curve.CreateInterpolatedCurve(ps, 1);
  }
  public Curve Rail1(double x){
    return  Rail1(x, 20);
  }

  List < string > RegEx(){
    List < string > strs = new  List<string>();
    for(int i = -15;i <= 45;i++) {
      strs.Add("^(");
    }
    for(int i = 0;i <= 20;i++){
      for(int j = -10;j <= 10;j++){
        double t = SolveAngle(new Point3d(i, j, 0));
        if(t == double.NaN)continue;
        int index = (int) Math.Round(t) + 15;
        if(index > 60 || index < 0)continue;
        string str = strs[index];
        if( str != "^(") str += "|";
        str += (i * 10 + j + 10).ToString();
        strs[index] = str;
      }
    }
    for(int i = -15;i <= 45;i++) {
      string str = strs[i + 15];
      str += ")$";
      strs[i + 15] = str;
    }
    return strs;
  }
  public double SolveAngle(Point3d des){
    for(double i = -15;i <= 65;i += 0.1){
      Curve r1 = Rail1(i);
      double t;
      r1.ClosestPoint(des, out t);
      Point3d pt = r1.PointAt(t);
      if(pt.DistanceTo(des) < 0.1){
        return i;
      }
    }
    return double.NaN;
  }

  public List<Line> Grid(){
    List<Line> output = new List<Line>();
    for(int i = 0;i <= 20;i++){
      output.Add(new Line(new Point3d(i * 10, -100, 0),
        new Point3d(i * 10, 100, 0)));

      output.Add(new Line(new Point3d(0, i * 10 - 100, 0),
        new Point3d(200, i * 10 - 100, 0)));
    }
    return output;
  }


  //Draw all wires and points in this method.
  public override void DrawViewportWires(IGH_PreviewArgs args)
  {
    for(int i = 0;i < dispc.Count;i++){
      args.Display.DrawCurve(dispc[i], System.Drawing.Color.Blue, 2);
    }
    for(int i = 0;i < dispc2.Count;i++){
      args.Display.DrawCurve(dispc2[i], System.Drawing.Color.Red, 2);
    }
    for(int i = 0;i < dispc3.Count;i++){
      args.Display.DrawCurve(dispc3[i], System.Drawing.Color.Orange, 2);
    }
    for(int i = 0;i < dispc4.Count;i++){
      args.Display.DrawCurve(dispc4[i], System.Drawing.Color.Pink, 2);
    }
    for(int i = 0;i < grids.Count;i++){
      args.Display.DrawLine(grids[i], System.Drawing.Color.Black, 1);
    }
  }
# ---------- end c_script ----------
galapagos = Galapagos(fitness=c_script, gene=[number_slider, number_slider_4, number_slider_2, number_slider_3])
panel_4 = Panel(c_script.out)
panel_5 = Panel(c_script.E)
