# Grasshopper definition Rail3.gh (Grasshopper 1.0.7)

number_slider = Slider(1.2988, range=0..2)
number_slider_2 = Slider(0.6295, range=0..2)
number_slider_3 = Slider(1.1186, range=0..5)
pt = Point(<point referenced from the Rhino model>)
galapagos = Galapagos(fitness=c_script, gene=[number_slider_2, number_slider_3, number_slider])
c_script = CSharpScript(
    pd=pt,
    angle=Slider(6.6, range=0..90),
    time=Slider(10, range=0..20),
    x=number_slider_2,
    y=number_slider_3,
    z=number_slider)  # -> out, A, B, C; inputs pd: Point3d, angle: Double, time: Double, x: Double, y: Double, z: Double
# ---------- c_script: C# ----------
    try{
      // /*
      List<Polyline> pls = new List<Polyline>();
      for(int i = 0;i < 81;i += 5){
        Polyline outa = Rail2(0 + i, 20, x, y, z);
        pls.Add(outa);
      }
      A = pls;
      B = total(x, y, z);
      // */
      /*
      Point3d pd1 = new Point3d (pd.X, pd.Y, 0);
      double angle1 = SolveAngle(1, pd1, x, y, z);
      A = Rail2(angle1, 10, x, y, z);
      B = angle1;
      C = pd;
      //*/
    }catch(Exception ex){
      Print(ex.ToString());

    }
# ---------- c_script: C# additional code ----------
  public  double WaterDragCoefficient = 0.1;
  public  double forceFactor = 1.0;
  public  double maxVelocity = 64.0;
  public  Vector3d Gravity = new Vector3d(0, -9.82, 0);
  public  double Density = 35,Mass = 1,Width = 2.15,Height = 0.30;
  public  double dt = 1.0 / 60.0;
  public  double NeutralDensity = 10.0;

  public double SolveAngle(double tol, Point3d pt, double t1, double  t2, double t3){
    for(int i = 0;i < 90;i += 1){
      Polyline pl1 = Rail2(i, 20, t1, t2, t3);
      double d = pl1.ClosestPoint(pt).DistanceTo(pt);
      if(d < tol){
        return i;
      }

    }
    return 0;
  }
  public Polyline Rail2(double angle, double time, double t1, double  t2, double t3){
    Vector3d frontVel = new Vector3d(maxVelocity * t3, 0, 0);
    Point3d localFront = new Point3d(0, 0, 0);
    Polyline ps = new Polyline();
    ps.Add(localFront);
    frontVel.Transform(Transform.Rotation(angle / 180.0 * Math.PI, Vector3d.ZAxis, localFront));
    for(double i = 0;i < time;i += dt){
      double speed = frontVel.Length;
      Vector3d dragVec = new Vector3d(frontVel);
      dragVec.Unitize();
      Vector3d a = -dragVec * (t1 * speed * speed * 0.01) + Gravity * t2;
      localFront = localFront + frontVel * dt + a * dt * dt / 2;
      frontVel = frontVel + a * dt;
      ps.Add(localFront);
    }
    return ps;
  }
  public Point3d intersect(Polyline pl, Line l){
    try{
      PolylineCurve pll = pl.ToPolylineCurve();
      Rhino.Geometry.Intersect.CurveIntersections CI = Rhino.Geometry.Intersect.Intersection.CurveLine(pll, l, 0.001, 0.001);
      if(CI.Count > 0){
        return (CI[0].PointA + CI[0].PointB) / 2;
      }
      else{
        return Point3d.Origin;
      }
    }catch{return Point3d.Origin;}
  }
  public double total(double d1, double d2, double d3){
    Line l1 = new Line(new Point3d(0, -10, 0), new Point3d(1200, -10, 0));
    Line l2 = new Line(new Point3d(0, -20, 0), new Point3d(1200, -20, 0));
    Line l3 = new Line(new Point3d(0, -30, 0), new Point3d(1200, -30, 0));
    Line l4 = new Line(new Point3d(0, -50, 0), new Point3d(1200, -50, 0));
    Line l5 = new Line(new Point3d(0, -0.1, 0), new Point3d(1200, -0.1, 0));
    Polyline pl1 = Rail2(0, 10, d1, d2, d3); //89,120,138,165
    Polyline pl2 = Rail2(33, 10, d1, d2, d3);//190
    Polyline pl3 = Rail2(22, 10, d1, d2, d3);//174
    Point3d p1,p2,p3,p4,p5,p6;
    p1 = intersect(pl1, l1); p2 = intersect(pl1, l2); p3 = intersect(pl1, l3);
    p4 = intersect(pl1, l4); p5 = intersect(pl2, l5); p6 = intersect(pl3, l5);
    return
      Math.Pow(p1.X - 89, 2) + Math.Pow(p2.X - 120, 2) + Math.Pow(p3.X - 138, 2) +
      Math.Pow(p4.X - 165, 2) + Math.Pow(p5.X - 190, 2) + Math.Pow(p6.X - 174, 2);
  }

  public Polyline Rail1(double angle, double time){
    double volume = Mass / Density;
    Vector3d frontVel = new Vector3d(maxVelocity * 0.95, 0, 0);
    Point3d localFront = new Point3d(0, 0, 0);
    Polyline ps = new Polyline();
    ps.Add(localFront);
    frontVel.Transform(Transform.Rotation(angle / 180.0 * Math.PI, Vector3d.ZAxis, localFront));
    for(double i = 0;i < time;i += dt){
      double speed = frontVel.Length;
      double drag = speed * speed * WaterDragCoefficient * volume * NeutralDensity;
      drag *= 9.82 * 0.02;
      Vector3d dragVec = new Vector3d(frontVel);
      dragVec.Unitize();
      dragVec *= -drag;
      Vector3d buoyancy = -Gravity * forceFactor * volume * NeutralDensity;
      localFront = localFront + frontVel * dt + (dragVec + buoyancy + Gravity ) / 2 * dt * dt;
      frontVel = frontVel + (dragVec + buoyancy + Gravity  ) * dt;
      ps.Add(localFront);
    }
    return ps;
  }
# ---------- end c_script ----------
lng = ListLength(List=c_script.A)
series = Series(Start=0, Step=1, Count=lng)
gradient = Gradient(
    LowerLimit=0,
    UpperLimit=lng,
    Parameter=series,
    stops=[0: RGB(243, 57, 0), 0.1: RGB(236, 27, 60), 0.2: RGB(210, 0, 118), 0.3: RGB(103, 0, 120), 0.4: RGB(39, 72, 161), 0.5: RGB(1, 192, 229), 0.6: RGB(18, 178, 90), 0.7: RGB(79, 186, 8), 0.8: RGB(220, 237, 32), 0.9: RGB(247, 159, 20), 1: RGB(243, 57, 0)])
preview = CustomPreview(Geometry=c_script.A, Material=gradient)
sqgrid = Square(Plane=PlaneXY(0, 0, 0), Size=10, ExtentX=30, ExtentY=30)  # -> Cells, Points
crv = Curve(sqgrid.Cells)
panel = Panel(gradient)
